# Grasshopper definition tetrahedron_Rev04.gh (Grasshopper 1.0.7)

# ---- group: Create prism at origin of document
int = Integer(1700)
int_2 = Integer(178)
rtrig = RightTrigonometry(PLength=int_2, RLength=int)  # -> Alpha, Beta, PLength, QLength, RLength
polygon = Polygon(Plane=PlaneXY(0, 0, 0), Radius=int_2, Segments=4, FilletRadius=0)  # -> Polygon, Length
Z = UnitZ(Factor=rtrig.QLength)
area = Area(Geometry=polygon.Polygon)  # -> Area, Centroid
debrep = DeconstructBrep(Brep=polygon.Polygon)  # -> Faces, Edges, Vertices
move = Move(Geometry=area.Centroid, Motion=Z)  # -> Geometry, Transform
ln = Line(StartPoint=move.Geometry, EndPoint=debrep.Vertices)
join = JoinCurves(Curves=[polygon.Polygon, ln], Preserve=False)

# ----
point_on_curve_as_proportion_of_length = Slider(0.817, range=0..1)

# ---- group: reference plane to align original geom
int_3 = Integer(50)
item = ListItem(List=ln, Index=Slider(1, range=0..3), Wrap=True)
midpt = CurveMiddle(Curve=item)
X = UnitX(Factor=int_3)
move_2 = Move(Geometry=midpt, Motion=X)  # -> Geometry, Transform
lnpt = LinePt(Line=item, Point=move_2.Geometry)

# ---- group: set curve geom here
crv = Curve(reparameterize(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))

# ---- group: Point O
eval = EvaluateCurve(Curve=crv, Parameter=point_on_curve_as_proportion_of_length)  # -> Point, Tangent, Angle

# ----
yz = YZPlane(Origin=Point(0, 0, 0))
int_4 = Integer(1700)

# ---- group: Find O1 using divide distance
shatter = Shatter(Curve=crv, Parameters=point_on_curve_as_proportion_of_length)
item_2 = ListItem(List=shatter, Index=1, Wrap=True)
divdist = DivideDistance(Curve=item_2, Distance=int)  # -> Points, Tangents, Parameters
item_3 = ListItem(List=divdist.Tangents, Index=1, Wrap=True)
item_4 = ListItem(List=divdist.Points, Index=1, Wrap=True)

# ---- group: Find point O1 using sphere
xy = XYPlane(Origin=eval.Point)
sph = Sphere(Base=xy, Radius=int_4)
bcx = BrepCurve(Brep=sph, Curve=crv)  # -> Curves, Points
item_5 = ListItem(List=bcx.Points, Index=1, Wrap=True)

# ----
ln_2 = Line(StartPoint=eval.Point, EndPoint=item_5)
ln_3 = Line(StartPoint=eval.Point, EndPoint=item_4)

# ---- group: Align to curve
pl = PlaneNormal(Origin=item_4, ZAxis=item_3)
polygon_2 = Polygon(Plane=pl, Radius=3, Segments=4, FilletRadius=0)  # -> Polygon, Length
debrep_2 = DeconstructBrep(Brep=polygon_2.Polygon)  # -> Faces, Edges, Vertices
item_6 = ListItem(List=debrep_2.Vertices, Index=0, Wrap=True)
lnpt_2 = LinePt(Line=ln_3, Point=item_6)
orient = Orient(Geometry=join, Source=lnpt, Target=lnpt_2)  # -> Geometry, Transform

# ----
len = Length(Curve=ln_2)
panel = Panel(len)
len_2 = Length(Curve=ln_3)
panel_2 = Panel(len_2)

# ---- group: reference plane to align original geom successive iterations
int_5 = Integer(50)
item_7 = ListItem(List=ln, Index=Slider(2, range=0..3), Wrap=True)
midpt_2 = CurveMiddle(Curve=item_7)
X_2 = UnitX(Factor=int_5)
move_3 = Move(Geometry=midpt_2, Motion=X_2)  # -> Geometry, Transform

# ----
flip = FlipCurve(Curve=item_7)  # -> Curve, Flag

# ---- group: reference plane to align original geom successive iterations (continued)
lnpt_3 = LinePt(Line=flip.Curve, Point=move_3.Geometry)

# ----
explode = Explode(Curve=orient.Geometry, Recursive=True)  # -> flatten(Segments), Vertices
end = EndPoints(Curve=explode.Segments)  # -> Start, End
cullpt = CullDuplicates(Points=end.Start, Tolerance=0.1, CullMode=3)  # -> Points, Indices, Valence
item_8 = ListItem(List=cullpt.Points, Index=4, Wrap=True)
item_9 = ListItem(List=cullpt.Points, Index=0, Wrap=True)
item_10 = ListItem(List=cullpt.Points, Index=1, Wrap=True)
ln_4 = Line(StartPoint=item_9, EndPoint=item_8)
end_2 = EndPoints(Curve=ln_4)  # -> Start, End
lnpt_4 = LinePt(Line=ln_4, Point=item_10)
vec2pt = Vector2Pt(PointA=end_2.Start, PointB=end_2.End, Unitize=False)  # -> Vector, Length
orient_2 = Orient(Geometry=join, Source=lnpt_3, Target=lnpt_4)  # -> Geometry, Transform
neg = Negative(Value=vec2pt.Vector)
move_4 = Move(Geometry=orient_2.Geometry, Motion=neg)  # -> Geometry, Transform
