# Grasshopper definition tetrahedron_Rev04_WIP.gh (Grasshopper 1.0.7)

# ---- group: Options 1-4
srf = Surface(<surface referenced from the Rhino model>)
srf_2 = Surface(<surface referenced from the Rhino model>)
srf_3 = Surface(<surface referenced from the Rhino model>)
# Secret receipy
srf_4 = Surface(<surface referenced from the Rhino model>)
merge = Merge(Data1=srf_4, Data2=srf, Data3=srf_2, Data4=srf_3)  # -> graft(Result)

# ---- group: curve processing logic
point_on_curve_as_proportion_of_length = Slider(0.109, range=0..1)

# ---- group: curve processing logic / set curve geom here
crv = Curve(reparameterize(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))

# ---- group: curve processing logic / Point O
eval = EvaluateCurve(Curve=crv, Parameter=point_on_curve_as_proportion_of_length)  # -> Point, Tangent, Angle

# ---- group: WIP / Plane angles
num = Number([0.48, 0, -0.48, 0])

# ---- group: WIP / alignment angles
int = Integer([0, 90, 180, 270])

# ----
weave = Weave(Pattern=[0, 1], Stream0=graft(int), Stream1=graft(num), NullGaps=False)

area = Area(Geometry=merge)  # -> Area, Centroid
pln = Plane(merge)
int_2 = Integer(1700)

# ---- group: plane normals
evalsrf = EvaluateSurface(Surface=merge, Point=area.Centroid)  # -> Point, flatten(Normal), flatten(UDirection), flatten(VDirection), Frame

# ---- group: final planes
final_pla = PlaneOrigin(Base=pln, Origin=area.Centroid)  # -> flatten(Plane)

# ---- group: reference yz planes
yz = YZPlane(Origin=area.Centroid)  # -> flatten(Plane)

# ---- group: origins
pt = Point(flatten(area.Centroid))

# ----
unit = UnitVector(Vector=evalsrf.VDirection)

# ---- group: prism alignment logic / Create prism at origin of document
int_3 = Integer(1700)
int_4 = Integer(178)
rtrig = RightTrigonometry(PLength=int_4, RLength=int_3)  # -> Alpha, Beta, PLength, QLength, RLength
polygon = Polygon(Plane=PlaneXY(0, 0, 0), Radius=int_4, Segments=4, FilletRadius=0)  # -> Polygon, Length
Z = UnitZ(Factor=rtrig.QLength)
area_2 = Area(Geometry=polygon.Polygon)  # -> Area, Centroid
debrep = DeconstructBrep(Brep=polygon.Polygon)  # -> Faces, Edges, Vertices
pdecon = Deconstruct(Point=debrep.Vertices)  # -> XComponent, YComponent, ZComponent
sort = SortList(Keys=pdecon.YComponent, ValuesA=debrep.Vertices)  # -> Keys, ValuesA
item = ListItem(List=sort.ValuesA, Index=0, Wrap=True)

# ----
bbox = BoundingBox(Content=polygon.Polygon, Plane=PlaneXY(0, 0, 0))  # -> Box, Box_2
debrep_2 = DeconstructBrep(Brep=bbox.Box)  # -> Faces, Edges, Vertices
len = Length(Curve=debrep_2.Edges)
division = Division(A=len, B=2)
multiplication = Multiplication(A=division, B=unit)

# ---- group: curve processing logic / Find O1 using divide distance
shatter = Shatter(Curve=crv, Parameters=point_on_curve_as_proportion_of_length)  # -> flatten(Segments)
item_2 = ListItem(List=shatter, Index=1, Wrap=True)
divdist = DivideDistance(Curve=item_2, Distance=int_3)  # -> flatten(Points), flatten(Tangents), Parameters
item_3 = ListItem(List=divdist.Points, Index=1, Wrap=True)
item_4 = ListItem(List=divdist.Tangents, Index=1, Wrap=True)

# ---- group: prism alignment logic / apex of reference prism
move = Move(Geometry=area_2.Centroid, Motion=Z)  # -> Geometry, Transform

# ---- group: prism alignment logic / Create prism at origin of document (continued)
ln = Line(StartPoint=move.Geometry, EndPoint=debrep.Vertices)  # -> flatten(Line)
item_5 = ListItem(List=ln, Index=Slider(1, range=0..3), Wrap=True)

# ---- group: prism alignment logic / reference prism
join = JoinCurves(Curves=[polygon.Polygon, ln], Preserve=False)  # -> flatten(Curves)

# ---- group: curve processing logic / line aligned to curve
ln_2 = Line(StartPoint=eval.Point, EndPoint=item_3)

# ---- group: prism alignment logic / reference plane to align original geom
lnpt = LinePt(Line=item_5, Point=item)

# ----
unit_2 = UnitVector(Vector=evalsrf.Normal)
multiplication_2 = Multiplication(A=int_2, B=unit_2)

# ---- group: 0 segment
item_6 = ListItem(List=multiplication_2, Index=0, Wrap=True)
item_7 = ListItem(List=multiplication, Index=0, Wrap=True)
item_8 = ListItem(List=pt, Index=0, Wrap=True)
item_9 = ListItem(List=yz, Index=0, Wrap=True)
item_10 = ListItem(List=final_pla, Index=0, Wrap=True)

# ----
vdisex = VectorDisplayEx(Point=item_10, Vector=item_6, Colour=RGB(0, 0, 0), Width=2)

vdisex_2 = VectorDisplayEx(Point=item_10, Vector=item_7, Colour=RGB(0, 0, 0), Width=2)

# ---- group: normal plane for alignment of reference plane to intermediate plane
pl = ConstructPlane(Origin=item_8, XAxis=item_6, YAxis=item_7)

# ---- group: INT Alignment / intermediate normal plane for track alignment - 0,.48
pl_2 = ConstructPlane(Origin=item_8, XAxis=item_10, YAxis=item_7)

# ---- group: INT Alignment / intermediate prism
orient = Orient(Geometry=join, Source=lnpt, Target=pl)  # -> Geometry, Transform

# ---- group: prism alignment logic / Align first reference prism to curve
pl_3 = PlaneNormal(Origin=item_3, ZAxis=item_4)
polygon_2 = Polygon(Plane=pl_3, Radius=30, Segments=4, FilletRadius=0)  # -> Polygon, Length
explode = Explode(Curve=polygon_2.Polygon, Recursive=True)  # -> Segments, Vertices
cullpt = CullDuplicates(Points=explode.Vertices, Tolerance=0.1, CullMode=3)  # -> flatten(Points), Indices, Valence

# ---- group: redundancy/ dataprocessing
bugfix_orientation_of_prism_1 = BugfixOrientationOfPrism1(L_2=cullpt.Points, L=cullpt.Points, P=cullpt.Points, A=cullpt.Points)  # -> L_3, Y

# ---- group: redundancy/ dataprocessing / make sign agnostic
sqr = Square(Value=bugfix_orientation_of_prism_1.Y)

# ---- group: redundancy/ dataprocessing (continued)
sort_2 = SortList(Keys=sqr, ValuesA=bugfix_orientation_of_prism_1.L_3)  # -> Keys, ValuesA

# ---- group: prism alignment logic / Align first reference prism to curve (continued)
item_11 = ListItem(List=sort_2.ValuesA, Index=-1, Wrap=True)
lnpt_2 = LinePt(Line=ln_2, Point=item_11)
orient_2 = Orient(Geometry=orient.Geometry, Source=pl, Target=lnpt_2)  # -> Geometry, Transform

# ---- group: prism alignment logic
explode_2 = Explode(Curve=orient_2.Geometry, Recursive=True)  # -> flatten(Segments), Vertices
end = EndPoints(Curve=explode_2.Segments)  # -> Start, End
cullpt_2 = CullDuplicates(Points=end.Start, Tolerance=0.1, CullMode=3)  # -> flatten(Points), Indices, Valence

# ---- group: redundancy/ dataprocessing (continued)
bugfix_whack_a_mole_fix = BugfixWhackAMoleFix(C_2=crv, L=cullpt_2.Points, C=crv, C_5=crv, G=cullpt_2.Points, C_4=crv, C_6=crv, C_3=crv)  # -> a, a_2
pt_2 = Point(bugfix_whack_a_mole_fix.a_2)

# ---- group: prism alignment logic / Return apex of 2nd prism
pt_3 = Point(bugfix_whack_a_mole_fix.a)

# ---- group: prism alignment logic / Orient intermediate prism to track alignment curve
pl_origin = PlaneOrigin(Base=pl_2, Origin=pt_3)
orient_3 = Orient(Geometry=orient.Geometry, Source=pl_2, Target=pl_origin)  # -> flatten(Geometry), Transform

# ---- group: dims check
explode_3 = Explode(Curve=orient_3.Geometry, Recursive=True)  # -> flatten(Segments), Vertices
explode_4 = Explode(Curve=join, Recursive=True)  # -> flatten(Segments), Vertices
len_2 = Length(Curve=explode_3.Segments)
len_3 = Length(Curve=explode_4.Segments)
panel = Panel(len_2)
panel_2 = Panel(len_3)

# ---- group: prism alignment logic / Loop start
geo = Geometry(orient_3.Geometry)

# ---- group: prism alignment logic / get closest point to curve
end_2 = EndPoints(Curve=geo)  # -> Start, End
cullpt_3 = CullDuplicates(Points=[end_2.Start, end_2.End], Tolerance=0.1, CullMode=3)  # -> Points, Indices, Valence
crvnear = CurveNearestObject(Curve=crv, Geometry=cullpt_3.Points)  # -> PointA, PointB, Index
pt_4 = Point(crvnear.PointB)

# ---- group: redundancy/ dataprocessing / clockwise point ordering logic
pdecon_2 = Deconstruct(Point=cullpt_3.Points)  # -> XComponent, YComponent, ZComponent
sort_3 = SortList(Keys=pdecon_2.ZComponent, ValuesA=cullpt_3.Points)  # -> Keys, flatten(ValuesA)
sort_4 = SortList(Keys=pdecon_2.YComponent, ValuesA=cullpt_3.Points)  # -> Keys, flatten(ValuesA)
item_12 = ListItem(List=sort_3.ValuesA, Index=0, Wrap=True)
item_13 = ListItem(List=sort_4.ValuesA, Index=0, Wrap=True)
index = ItemIndex(List=cullpt_3.Points, Item=[item_13, item_12])  # -> flatten(Index)
cull_i = CullIndex(List=cullpt_3.Points, Indices=index, Wrap=True)  # -> flatten(List)
item_14 = ListItem(List=cull_i, Index=0, Wrap=True)
item_15 = ListItem(List=cull_i, Index=1, Wrap=True)
ln_3 = Line(StartPoint=item_12, EndPoint=item_14)
ln_4 = Line(StartPoint=item_12, EndPoint=item_13)
ln_5 = Line(StartPoint=item_12, EndPoint=item_15)
angle = Angle(VectorA=ln_4, VectorB=ln_3)  # -> Angle, Reflex
angle_2 = Angle(VectorA=ln_4, VectorB=ln_5)  # -> Angle, Reflex
angle_3 = Angle(VectorA=ln_4, VectorB=ln_4)  # -> Angle, Reflex
end_3 = EndPoints(Curve=[ln_3, ln_5, ln_4])  # -> Start, End
merge_2 = Merge(Data1=angle.Angle, Data2=angle_2.Angle, Data3=angle_3.Angle)  # -> reverse(Result)
weave_2 = Weave(Pattern=[0, 1], Stream0=graft(merge_2), Stream1=graft(end_3.End), NullGaps=False)
item_16 = ListItem(List=weave_2, Index=0, Wrap=True)
item_17 = ListItem(List=weave_2, Index=1, Wrap=True)

# ---- group: WIP / select remaining item in clockwise direction
sort_5 = SortList(Keys=flatten(item_16), ValuesA=flatten(item_17))  # -> Keys, reverse(ValuesA)
ins = InsertItems(List=sort_5.ValuesA, Item=item_12, Indices=0, Wrap=True)  # -> graft(List)

# ----
item_18 = ListItem(List=ins, Index=Slider(0, range=0..3), Wrap=True)
weave_3 = Weave(Pattern=[0, 1], Stream0=ins, Stream1=weave, NullGaps=False)
panel_3 = Panel(weave_3)

# ---- group: WIP / tag point based on alignment angle
item_19 = ListItem(List=weave_3, Index=1, Wrap=True)
item_20 = ListItem(List=weave_3, Index=0, Wrap=True)
tag = TextTag(Location=item_20, Text=item_19, Colour=ColourSwatch(SwatchColor=RGB(0, 242, 255)))

# ---- group: WIP / Return closest point and plane and angle and alignment angle
python = GhPythonScript(x=weave_3, y=pt_4)  # -> out, a; inputs x: tree, y: Point3d
# ---------- python: Python ----------
__author__ = "BalajiI"
__version__ = "2024.02.21"

import rhinoscriptsyntax as rs
import ghpythonlib.treehelpers as th

tag_point = []
y_coord_x = y.X
y_coord_y = y.Y
y_coord_z = y.Z

def ComparePoint(point3d_a,point3d_b):
    return point3d_a.X == point3d_b.X and point3d_a.Y == point3d_b.Y and point3d_a.Z == point3d_b.Z
    
for i in range(x.BranchCount):
    branchList = x.Branch(i)
#compare coodinates of y input with point in branch item
    if ComparePoint(y,branchList[0]) :
        tag_point.append(branchList)
        
#        tag_point.append(branchList[1])
#    
a = th.list_to_tree(tag_point)
# ---------- end python ----------

# ----
panel_4 = Panel(weave_2)

# ---- group: WIP
panel_5 = Panel(python.a)

# ==== cluster BugfixWhackAMoleFix
C = ClusterInput()
G = ClusterInput()
crvnear = CurveNearestObject(Curve=C, Geometry=G)  # -> PointA, PointB, Index
L = ClusterInput()
C_2 = ClusterInput()
cull_i = CullIndex(List=L, Indices=crvnear.Index, Wrap=True)
C_3 = ClusterInput()
C_4 = ClusterInput()
crvnear_2 = CurveNearestObject(Curve=C_2, Geometry=cull_i)  # -> PointA, PointB, Index
crv_cp = CurveClosestPoint(Point=crvnear_2.PointA, Curve=C_3)  # -> Point, Parameter, Distance
crv_cp_2 = CurveClosestPoint(Point=crvnear.PointA, Curve=C_4)  # -> Point, Parameter, Distance
C_5 = ClusterInput()
C_6 = ClusterInput()
shatter = Shatter(Curve=C_5, Parameters=crv_cp_2.Parameter)
shatter_2 = Shatter(Curve=C_6, Parameters=crv_cp.Parameter)
len = Length(Curve=shatter_2)
len_2 = Length(Curve=shatter)
item = ListItem(List=len_2, Index=1, Wrap=True)
item_2 = ListItem(List=len, Index=1, Wrap=True)
python = GhPythonScript(x=crv_cp_2.Point, u=crv_cp.Point, y=item, z=item_2)  # -> out, a
# ---------- python: Python ----------
__author__ = "BalajiI"
__version__ = "2024.02.21"

import rhinoscriptsyntax as rs

list_points = []
list_lengths  = []

list_points.append(x)
list_points.append(u)
list_lengths.append(y)
list_lengths.append(z)

points_dict = dict(zip(list_points,list_lengths))
output = [key for key in points_dict if points_dict[key]==min(points_dict.values())]
a = output
# ---------- end python ----------
python_2 = GhPythonScript(x=crv_cp_2.Point, u=crv_cp.Point, y=item, z=item_2)  # -> out, a
# ---------- python_2: Python ----------
__author__ = "BalajiI"
__version__ = "2024.02.21"

import rhinoscriptsyntax as rs

list_points = []
list_lengths  = []

list_points.append(x)
list_points.append(u)
list_lengths.append(y)
list_lengths.append(z)

points_dict = dict(zip(list_points,list_lengths))
output = [key for key in points_dict if points_dict[key]==max(points_dict.values())]
a = output
# ---------- end python_2 ----------
a = ClusterOutput(python.a)
a_2 = ClusterOutput(python_2.a)

# ==== cluster BugfixOrientationOfPrism1
A = ClusterInput()
P = ClusterInput()
L = ClusterInput()
L_2 = ClusterInput()

# ---- group: Bugfix: ensure consistent orientation wrt world xyx / pick item with least z component "angle 0"
pdecon = Deconstruct(Point=P)  # -> XComponent, YComponent, ZComponent
sort = SortList(Keys=pdecon.ZComponent, ValuesA=A)  # -> Keys, ValuesA

# ---- group: Bugfix: ensure consistent orientation wrt world xyx / Origin "0 angle point"
item = ListItem(List=sort.ValuesA, Index=0, Wrap=True)

# ---- group: Bugfix: ensure consistent orientation wrt world xyx / remove 0 angle point from list of points
index = ItemIndex(List=L, Item=item)
cull_i = CullIndex(List=L_2, Indices=index, Wrap=True)

# ----
L_3 = ClusterOutput(cull_i)

# ---- group: Bugfix: ensure consistent orientation wrt world xyx / construct local coodinate system
vec2pt = Vector2Pt(PointA=item, PointB=cull_i, Unitize=False)  # -> Vector, Length
pdecon_2 = Deconstruct(Point=vec2pt.Vector)  # -> XComponent, YComponent, ZComponent
sort_2 = SortList(Keys=pdecon_2.YComponent, ValuesA=vec2pt.Vector)  # -> Keys, ValuesA
item_2 = ListItem(List=sort_2.ValuesA, Index=0, Wrap=True)
item_3 = ListItem(List=sort_2.ValuesA, Index=2, Wrap=True)
xprod = CrossProduct(VectorA=item_3, VectorB=item_2, Unitize=False)  # -> Vector, Length
pl = PlaneNormal(Origin=item, ZAxis=xprod.Vector)
plcoord = PlaneCoordinates(Point=cull_i, System=pl)  # -> flatten(XCoordinate), flatten(YCoordinate), ZCoordinate

# ----
Y = ClusterOutput(plcoord.YCoordinate)
